# Grasshopper definition 211031-WFC-BASE.gh (Grasshopper 1.0.7)
# plug-ins: Bifocals, Monoceros

# ---- group: Module
geometry_pipeline = GeometryPipeline(
    GroupByLayer=False,
    GroupByType=False,
    IncludeHidden=True,
    IncludeLocked=True,
    LayerFilter="Base::Walls::Voxels",
    NameFilter="*",
    SublayerFiltering=True,
    TypeFilter=1073741852)
geometry_pipeline_2 = GeometryPipeline(
    GroupByLayer=False,
    GroupByType=False,
    IncludeHidden=True,
    IncludeLocked=True,
    LayerFilter="Base::Walls::Surfaces",
    NameFilter="*",
    SublayerFiltering=True,
    TypeFilter=1073741885)
bounding_box = BoundingBox(Content=geometry_pipeline_2, Plane=PlaneXY(0, 0, 0))  # -> Box, Box_2
graft_tree = GraftTree(Tree=geometry_pipeline_2, IncludeEmptyLists=True, IncludeNullItems=True)
graft_tree_2 = GraftTree(Tree=geometry_pipeline, IncludeEmptyLists=True, IncludeNullItems=True)
box_properties = BoxProperties(Box=bounding_box.Box)  # -> Center, Diagonal, Area, Volume, Degeneracy
tree_statistics = TreeStatistics(Tree=graft_tree)  # -> Paths, Length, Count
box_properties_2 = BoxProperties(Box=graft_tree_2)  # -> Center, Diagonal, Area, Volume, Degeneracy
point_in_breps = PointInBreps(Brep=geometry_pipeline, Point=box_properties.Center, Strict=False, UseTasks=False)  # -> Inside, Index
replace_paths = ReplacePaths(Data=simplify(graft_tree), Search=simplify(tree_statistics.Paths), Replace=simplify(point_in_breps.Index))
replace_paths_2 = ReplacePaths(Data=simplify(box_properties_2.Center), Search=simplify(tree_statistics.Paths), Replace=simplify(point_in_breps.Index))
tree_statistics_2 = TreeStatistics(Tree=replace_paths)  # -> Paths, Length, Count
series = Series(Start=0, Step=1, Count=Slider(29, range=0..100))
concatenate = Concatenate(FragmentA="Walls-", FragmentB=series)  # -> graft(Result)
xy = XYPlane(Origin=Point(0, 0, 0))
panel = Panel("3.6,3.6,4.2")
xy_2 = XYPlane(Origin=xy)
construct_module = ConstructModule(
    ModuleName=concatenate,
    ModulePartPoints=box_properties_2.Center,
    Geometry=replace_paths,
    BasePlane=xy_2,
    ModulePartDiagonal=panel)  # -> flatten(Module)

geometry_pipeline_3 = GeometryPipeline(
    GroupByLayer=False,
    GroupByType=False,
    IncludeHidden=True,
    IncludeLocked=True,
    LayerFilter="Base::Roofs::Voxels",
    NameFilter="*",
    SublayerFiltering=True,
    TypeFilter=1073741852)
geometry_pipeline_4 = GeometryPipeline(
    GroupByLayer=False,
    GroupByType=False,
    IncludeHidden=True,
    IncludeLocked=True,
    LayerFilter="Base::Roofs::Surfaces",
    NameFilter="*",
    SublayerFiltering=True,
    TypeFilter=1073741885)
bounding_box_2 = BoundingBox(Content=geometry_pipeline_4, Plane=PlaneXY(0, 0, 0))  # -> Box, Box_2
graft_tree_3 = GraftTree(Tree=geometry_pipeline_4, IncludeEmptyLists=True, IncludeNullItems=True)
graft_tree_4 = GraftTree(Tree=geometry_pipeline_3, IncludeEmptyLists=True, IncludeNullItems=True)
box_properties_3 = BoxProperties(Box=bounding_box_2.Box)  # -> Center, Diagonal, Area, Volume, Degeneracy
tree_statistics_3 = TreeStatistics(Tree=graft_tree_3)  # -> Paths, Length, Count
box_properties_4 = BoxProperties(Box=graft_tree_4)  # -> Center, Diagonal, Area, Volume, Degeneracy
point_in_breps_2 = PointInBreps(Brep=geometry_pipeline_3, Point=box_properties_3.Center, Strict=False, UseTasks=False)  # -> Inside, Index
replace_paths_3 = ReplacePaths(Data=simplify(graft_tree_3), Search=simplify(tree_statistics_3.Paths), Replace=simplify(point_in_breps_2.Index))
replace_paths_4 = ReplacePaths(
    Data=simplify(box_properties_4.Center),
    Search=simplify(tree_statistics_3.Paths),
    Replace=simplify(point_in_breps_2.Index))
tree_statistics_4 = TreeStatistics(Tree=replace_paths_3)  # -> Paths, Length, Count
series_2 = Series(Start=0, Step=1, Count=tree_statistics_4.Count)
concatenate_2 = Concatenate(FragmentA="Roofs-", FragmentB=series_2)  # -> graft(Result)
xy_3 = XYPlane(Origin=Point(0, 0, 0))
xy_4 = XYPlane(Origin=xy_3)
construct_module_2 = ConstructModule(
    ModuleName=concatenate_2,
    ModulePartPoints=box_properties_4.Center,
    Geometry=replace_paths_3,
    BasePlane=xy_4,
    ModulePartDiagonal="3.6,3.6,4.2")  # -> flatten(Module)

geometry_pipeline_5 = GeometryPipeline(
    GroupByLayer=False,
    GroupByType=False,
    IncludeHidden=True,
    IncludeLocked=True,
    LayerFilter="Base::Floors::Voxels",
    NameFilter="*",
    SublayerFiltering=True,
    TypeFilter=1073741852)
geometry_pipeline_6 = GeometryPipeline(
    GroupByLayer=False,
    GroupByType=False,
    IncludeHidden=True,
    IncludeLocked=True,
    LayerFilter="Base::Floors::Surfaces",
    NameFilter="*",
    SublayerFiltering=True,
    TypeFilter=1073741885)
bounding_box_3 = BoundingBox(Content=geometry_pipeline_6, Plane=PlaneXY(0, 0, 0))  # -> Box, Box_2
graft_tree_5 = GraftTree(Tree=geometry_pipeline_6, IncludeEmptyLists=True, IncludeNullItems=True)
graft_tree_6 = GraftTree(Tree=geometry_pipeline_5, IncludeEmptyLists=True, IncludeNullItems=True)
box_properties_5 = BoxProperties(Box=bounding_box_3.Box)  # -> Center, Diagonal, Area, Volume, Degeneracy
tree_statistics_5 = TreeStatistics(Tree=graft_tree_5)  # -> Paths, Length, Count
box_properties_6 = BoxProperties(Box=graft_tree_6)  # -> Center, Diagonal, Area, Volume, Degeneracy
point_in_breps_3 = PointInBreps(Brep=geometry_pipeline_5, Point=box_properties_5.Center, Strict=False, UseTasks=False)  # -> Inside, Index
replace_paths_5 = ReplacePaths(Data=graft_tree_5, Search=simplify(tree_statistics_5.Paths), Replace=simplify(point_in_breps_3.Index))
replace_paths_6 = ReplacePaths(
    Data=simplify(box_properties_6.Center),
    Search=simplify(tree_statistics_5.Paths),
    Replace=simplify(point_in_breps_3.Index))
tree_statistics_6 = TreeStatistics(Tree=replace_paths_5)  # -> Paths, Length, Count
series_3 = Series(Start=0, Step=1, Count=tree_statistics_6.Count)
concatenate_3 = Concatenate(FragmentA="Floors-", FragmentB=series_3)  # -> graft(Result)
xy_5 = XYPlane(Origin=Point(0, 0, 0))
xy_6 = XYPlane(Origin=xy_5)
construct_module_3 = ConstructModule(
    ModuleName=concatenate_3,
    ModulePartPoints=box_properties_6.Center,
    Geometry=replace_paths_5,
    BasePlane=xy_6,
    ModulePartDiagonal="3.6,3.6,4.2")  # -> flatten(Module)

# ---- group: Rules
M = Module([construct_module_2, construct_module, construct_module_3])
geometry_pipeline_7 = GeometryPipeline(
    GroupByLayer=False,
    GroupByType=False,
    IncludeHidden=True,
    IncludeLocked=True,
    LayerFilter="BoundaryPoints::Points",
    NameFilter="*",
    SublayerFiltering=True,
    TypeFilter=1)
geometry_pipeline_8 = GeometryPipeline(
    GroupByLayer=False,
    GroupByType=False,
    IncludeHidden=True,
    IncludeLocked=True,
    LayerFilter="Lines",
    NameFilter="*",
    SublayerFiltering=True,
    TypeFilter=1073741852)
deconmodule = DeconstructModule(Module=M)  # -> flatten(ModuleName), ModulePartCenterPoints, Geometry, BasePlane, ModulePartDiagonal, IsCompact, IsValid, Connectors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
pt = Point(deconmodule.Connectors)
pt_2 = Point(geometry_pipeline_7)
crv = Curve(geometry_pipeline_8)
cp = ClosestPoint(Point=graft(pt_2), Cloud=flatten(pt))  # -> ClosestPoint, CPIndex, Distance
pt_3 = Point(flatten(cp.ClosestPoint))
ruleexpcrv = ExplicitRuleFromCurve(Modules=M, ConnectionCurve=crv)  # -> flatten(Rules)
ruleboundpt = RuleAtBoundaryFromPoint(Modules=M, PointTag=pt_3)
R = Rule(flatten([ruleexpcrv, ruleboundpt]))
ruleindiffunused = IndifferentRulesForUnusedConnectors(Module=M, Rules=flatten(R))
deconruletyp = DeconstructTypedRule(Rule=ruleindiffunused)  # -> ModuleName, ConnectorIndex, Type
rulebound = ConstructRuleAtBoundary(Module=graft(M), ConnectorIndex=deconruletyp.ConnectorIndex)
R_2 = Rule(flatten([R, rulebound]))
rulepreview = PreviewRules(Modules=M, Rules=R_2)

# ---- group: Module
geometry = Geometry(<brep referenced from the Rhino model>)
diagonal = Text(panel)
pln = Plane(xy_2)
slice_geometry = SliceGeometry(Geometry=geometry, BasePlane=pln, GridSlotDiagonal=diagonal, FillMethod=Slider(2, range=0..3), Precision=0.5)
pt_4 = Point([<point referenced from the Rhino model> x280])
diagonal_2 = Text(panel)
pt_5 = Point(slice_geometry)
M_2 = Module(M)
pln_2 = Plane(xy_2)
construct_slot_with_listed_modules_allow = ConstructSlotWithListedModulesAllowed(SlotPoint=pt_4, BasePlane=pln_2, GridSlotDiagonal=diagonal_2, AllowedModuleNames=M_2, Modules=M_2)

# ---- group: Solver
module = Module(flatten(M))
rule = Rule(flatten(R_2))
slot = Slot(flatten(construct_slot_with_listed_modules_allow))
monoceros_wfc_solver = MonocerosWFCSolver(
    Slots=slot,
    Modules=module,
    Rules=rule,
    RandomSeed=Slider(45, range=0..100),
    MaxAttempts=Slider(751, range=0..1000),
    MaxObservations=2147483647,
    MaxTime=0,
    UseShannonEntropy=True)  # -> Out, Slots, Deterministic, Contradictory, Seed, Attempts, Observations
materialize_slots = MaterializeSlots(Modules=module, Slots=monoceros_wfc_solver.Slots)  # -> Geometry, Transform
panel_2 = Panel(monoceros_wfc_solver.Out)
preview = CustomPreview(Geometry=materialize_slots.Geometry, Material=ColourSwatch(SwatchColor=RGB(194, 194, 194)))
