# Grasshopper definition Goldfinger Demo.gh (Grasshopper 1.0.7)
# Copyright: 2021-25-30
# Copyright: 2021
# Copyright: 2021-13-26
# plug-ins: InteractiveTownBuilder, Monoceros, HDTTreeUtils, Human, treesloth01

# ----
# Reset the world
button = Button()

layers = Panel("Monoceros::Modules::")

# ----
# Set enable to true and hit the reset button.
# Now you can click away!
toggle = BooleanToggle(False)

# ----
# Size of world
number_slider = Slider(55, range=0..500)
cluster = Cluster(B=number_slider, B_2=number_slider, B_3=Slider(33, range=0..500))
cluster_2 = Cluster_2(B=cluster)

# ---- group: Tile size
# Project Goldfinger
number_slider_2 = Slider(3.6, range=2..6)
number_slider_3 = Slider(4.2, range=2..6)

# ----
# Goldfinger
toggle_2 = BooleanToggle(False)
# AEC Hackathon 2021
itb = InteractiveTownBuilder(
    BoundingBox=cluster,
    XSize=number_slider_2,
    YSize=number_slider_2,
    ZSize=number_slider_3,
    Enable=toggle,
    Reset=button,
    AllowCantilever=toggle_2)  # -> Slots, Boxes, Model
text = Text(F=number_slider_3, box=cluster)
game_board = GameBoard(B=cluster, F=number_slider_3)

dpipeline = DynamicGeometryPipeline(
    LayerFilter=layers,
    TypeFilter="All",
    NameFilter="*",
    GroupByLayer=False,
    GroupByType=False,
    IncludeHidden=True,
    IncludeLocked=True,
    enableFullPath=True,
    listenToAttributes=True)  # -> simplify(GeometryOut)

# ---- group: Setup slots (game world)
# Minecraft boxes to Monoceros slots
# (crappy workaround)
python = GhPythonScript(model=itb.Model)  # -> out, boxesMesh
# ---------- python: Python ----------
__author__ = "mm1013"
__version__ = "2021.10.31"

import rhinoscriptsyntax as rs
import ghpythonlib as ghp

boxesMesh = [model.GetFaces(vox) for vox in model.Voxels if vox.Z !=0]


boxesMesh = ghp.treehelpers.list_to_tree(boxesMesh)
# ---------- end python ----------
mjoin = MeshJoin(Meshes=python.boxesMesh)
area = Area(Geometry=mjoin)  # -> Area, Centroid
pt = Point(flatten(area.Centroid))

# ---- group: Setup slots (game world) / diagonal
# Cage diagonal
xy = XYPlane(Origin=Point(0, 0, 0))
xy_2 = XYPlane(Origin=Point(1.8, 1.8, -2.1))
pt_2 = ConstructPoint(XCoordinate=number_slider_2, YCoordinate=number_slider_2, ZCoordinate=number_slider_3)
pln = Plane(xy)
move = Move(Geometry=pln, Motion=expr("x*0.5", pt_2))  # -> Geometry, Transform
diagonal = Vector(pt_2)

# ---- group: Setup slots (game world)
# Setup Monoceros environment
construct_slot_with_all_modules_allowed = ConstructSlotWithAllModulesAllowed(SlotPoint=pt, BasePlane=move.Geometry, GridSlotDiagonal=pt_2)

# preview slots
S = Slot(construct_slot_with_all_modules_allowed)

# ---- group: Modules
# Modules (geometry to be placed in the "world")
layers_2 = Panel("Monoceros::Cages")
layers_3 = Panel("""Walls
Roofs
Windows""")
expression = Expression(layer=layers_3, Expression="Format(\"Monoceros::Modules::{0}\", layer)")
dpipeline_2 = DynamicGeometryPipeline(
    LayerFilter=expression,
    TypeFilter="All",
    NameFilter="*",
    GroupByLayer=False,
    GroupByType=False,
    IncludeHidden=True,
    IncludeLocked=True,
    enableFullPath=True,
    listenToAttributes=True)  # -> simplify(GeometryOut)
dpipeline_3 = DynamicGeometryPipeline(
    LayerFilter=layers_2,
    TypeFilter="All",
    NameFilter="*",
    GroupByLayer=False,
    GroupByType=False,
    IncludeHidden=True,
    IncludeLocked=True,
    enableFullPath=True,
    listenToAttributes=True)  # -> simplify(GeometryOut)
lng = ListLength(List=dpipeline_2)
cull = CullPattern(List=layers_3, CullPattern=flatten(lng))
box_properties = BoxProperties(Box=dpipeline_3)  # -> Center, Diagonal, Area, Volume, Degeneracy

# ----
meshit = MeshIt(mesh_brep=graft(dpipeline_2))
shift = ShiftPaths(Data=meshit, Offset=-1)

# ---- group: Modules
# layer colors
layertable = LayerTable(Update=True, AutoUpdate=invert(False))  # -> Layers, FullLayerPaths, LayerColors, Linetypes, MaterialNames, Visible, PrintWidth, PrintColor
x_y = XY(Expression="x=y", X=layertable.FullLayerPaths, Y=graft(expression))
cull_2 = CullPattern(List=layertable.LayerColors, CullPattern=x_y)

clean = CleanTree(RemoveNulls=True, RemoveInvalid=True, RemoveEmpty=True, Tree=shift)
cluster_3 = Cluster_4(content=clean)

# ---- group: Modules / matching close
cluster_4 = Cluster_5(V=box_properties.Diagonal)
rtreematch = RTreeMatch(geoCenters=cluster_3, cageCenters=box_properties.Center, threshold=cluster_4)  # -> closestCagePerGeo; inputs geoCenters: list of Point3d, cageCenters: list of Point3d, threshold: Double
# ---------- rtreematch: C# usings ----------
using System.Linq;
using System.Threading.Tasks;
# ---------- rtreematch: C# ----------
    Component.Name = Component.NickName = "rTreeMatch";
    Component.Description = "Matching Points with RTree\nAuthor Mathias Sønderskov Schaltz 2021";
    Component.Category = "User";
    Component.SubCategory = "List";

    Component.IconDisplayMode = GH_IconDisplayMode.name;

    Component.Params.Input[0].Description = "Set A to match";

    Component.Params.Input[1].Description = "Set B to match";

    Component.Params.Input[2].Description = "threshold in document units";




    Component.Params.Output[0].Description = "Index of Set B that is closest to point in Set B";
    
   
   
   
   
   
    RTree rTree = new RTree();
    List<List<int>> potentialCagesPerGeometry = new List<List<int>>();

    int[] closestCagePerGeometry = Populate(new int[geoCenters.Count], -1);

    for (int i = 0; i < geoCenters.Count; i++)
    {
      potentialCagesPerGeometry.Add(new List<int>());
    }


    for (int i = 0; i < cageCenters.Count; i++)
    {
      rTree.Insert(cageCenters[i], i);
    }


    for (int i = 0; i < geoCenters.Count; i++)
    {
      rTree.Search(
        new Sphere(geoCenters[i], threshold),
        (sender, args) => {potentialCagesPerGeometry[i].Add(args.Id); });
    }

    for (int i = 0; i < potentialCagesPerGeometry.Count; i++)
    {
      potentialCagesPerGeometry[i] = potentialCagesPerGeometry[i].Distinct().ToList();
    }

    Parallel.For(0, geoCenters.Count, i =>
      {
      double dist = double.MaxValue;

      if (potentialCagesPerGeometry.Count > 0)
      {
        for (int j = 0; j < potentialCagesPerGeometry[i].Count; j++)
        {


          Point3d target = cageCenters[potentialCagesPerGeometry[i][j]];

          double distance = geoCenters[i].DistanceTo(target);

          if (distance < dist)
          {
            closestCagePerGeometry[i] = potentialCagesPerGeometry[i][j];
            dist = distance;
          }
        }
      }
      });



    closestCagePerGeo = closestCagePerGeometry;
# ---------- rtreematch: C# additional code ----------
  public static T[] Populate<T>(T[] arr, T value)
  {
  for (int i = 0; i < arr.Length; i++)
  {
  arr[i] = value;
}

        return arr;
  }
# ---------- end rtreematch ----------

# ---- group: Modules
# Naming is buggy
long = LongestList(ListA=graft(cull), ListB=clean, PaddingMode=2)  # -> ListA, ListB

# ----
mcol = MeshColours(Mesh=clean, Colours=cull_2)

# ---- group: Modules (continued)
item = ListItem(List=box_properties.Center, Index=rtreematch, Wrap=False)
assign_paths = AssignPaths(InputData=flatten(mcol), PathsToAssign=flatten(rtreematch))
assign_paths_2 = AssignPaths(InputData=flatten(long.ListA), PathsToAssign=flatten(rtreematch))
assign_paths_3 = AssignPaths(InputData=flatten(item), PathsToAssign=flatten(rtreematch))
item_2 = ListItem(List=assign_paths_2, Index=0, Wrap=True)
item_3 = ListItem(List=assign_paths_3, Index=0, Wrap=True)

geometries = Geometry(assign_paths)
prefix = Text(item_2)
cagecenter = Point(item_3)

cluster_5 = Cluster_3(prefix=prefix, C=geometries)  # -> simplify(module_name)
construct_module = ConstructModule(ModuleName=cluster_5, ModulePartPoints=cagecenter, Geometry=geometries, BasePlane=xy, ModulePartDiagonal=pt_2)  # -> flatten(Module)
module = Module(flatten(construct_module))

# ---- group: preview
cluster_6 = Cluster_6(C=[geometries, cagecenter], color=ColourSwatch(SwatchColor=RGB(255, 255, 255)))

# ---- group: Slots (old)
number_slider_4 = Slider(0, range=0..3)  # disabled
diagonal_2 = Text(pt_2)  # disabled
geometry = Geometry(<brep referenced from the Rhino model>)  # disabled
pln_2 = Plane(xy)  # disabled
slice_geometry = SliceGeometry(Geometry=geometry, BasePlane=pln_2, GridSlotDiagonal=diagonal_2, FillMethod=number_slider_4, Precision=0.5)  # disabled
pt_3 = Point([<point referenced from the Rhino model> x280])  # disabled
M = Module(construct_module)  # disabled
diagonal_3 = Text(pt_2)  # disabled
pln_3 = Plane(xy)  # disabled
construct_slot_with_listed_modules_allow = ConstructSlotWithListedModulesAllowed(SlotPoint=slice_geometry, BasePlane=pln_3, GridSlotDiagonal=diagonal_3, AllowedModuleNames=M, Modules=M)  # disabled

# ---- group: Rules / Curves
dpipeline_4 = DynamicGeometryPipeline(
    LayerFilter="Monoceros::Rules::Lines",
    TypeFilter="Curve",
    NameFilter="*",
    GroupByLayer=False,
    GroupByType=False,
    IncludeHidden=True,
    IncludeLocked=True,
    enableFullPath=True,
    listenToAttributes=True)
crv = Curve(dpipeline_4)
M_2 = Module(construct_module)
ruleexpcrv = ExplicitRuleFromCurve(Modules=M_2, ConnectionCurve=crv)  # -> flatten(Rules)
R = Rule(flatten(ruleexpcrv))
rulepreview = PreviewRules(Modules=M_2, Rules=ruleexpcrv)

# ---- group: Rules / Indifferent
dpipeline_5 = DynamicGeometryPipeline(
    LayerFilter="Monoceros::Rules::PointRules::Indifferent",
    TypeFilter="Point",
    NameFilter="*",
    GroupByLayer=False,
    GroupByType=False,
    IncludeHidden=True,
    IncludeLocked=True,
    enableFullPath=True,
    listenToAttributes=True)
pt_4 = Point(dpipeline_5)

# ---- group: Rules
M_3 = Module(construct_module)
dpipeline_6 = DynamicGeometryPipeline(
    LayerFilter="Monoceros::Rules::PointRules::Out",
    TypeFilter="Point",
    NameFilter="*",
    GroupByLayer=False,
    GroupByType=False,
    IncludeHidden=True,
    IncludeLocked=True,
    enableFullPath=True,
    listenToAttributes=True)

# ----
# Bake all points for
# cages to snap to here
deconmodule = DeconstructModule(Module=M_3)  # -> ModuleName, ModulePartCenterPoints, Geometry, BasePlane, ModulePartDiagonal, IsCompact, IsValid, Connectors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
pt_5 = Point(deconmodule.Connectors)
group = Group(Objects=flatten(pt_5))

# ---- group: Rules
dpipeline_7 = DynamicGeometryPipeline(
    LayerFilter="Monoceros::Rules::PointRules::Specifics::*",
    TypeFilter="Point",
    NameFilter="*",
    GroupByLayer=False,
    GroupByType=False,
    IncludeHidden=True,
    IncludeLocked=True,
    enableFullPath=True,
    listenToAttributes=True)
M_4 = Module(M_3)
objatts = ObjectAttributes(ObjectOrAttributes=dpipeline_7)  # -> Name, LayerName, LayerFullPath, Color, MaterialName, LinetypeName, GroupIndices, PlotWeight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
cset = CreateSet(List=objatts.LayerName)  # -> Set, Map
assign_paths_4 = AssignPaths(InputData=flatten(dpipeline_7), PathsToAssign=flatten(cset.Map))
panel = Panel(cset.Set)
ruletyppt = TypedRuleFromPoint(Modules=M_4, PointTag=assign_paths_4, ConnectorType=graft(panel))  # -> flatten(Rules)
rulepreview_2 = PreviewRules(Modules=M_4, Rules=ruletyppt)
R_2 = Rule(ruletyppt)

# ---- group: Rules / Out
pt_6 = Point(dpipeline_6)
M_5 = Module(M_3)
ruleboundpt = RuleAtBoundaryFromPoint(Modules=flatten(M_5), PointTag=pt_6)  # -> flatten(Rules)
rulepreview_3 = PreviewRules(Modules=M_5, Rules=ruleboundpt)
R_3 = Rule(ruleboundpt)

# ---- group: Rules / Indifferent (continued)
M_6 = Module(M_3)
ruleboundpt_2 = RuleAtBoundaryFromPoint(Modules=graft(M_6), PointTag=pt_4)  # -> simplify(Rules)
ruleboundpt_3 = RuleAtBoundaryFromPoint(Modules=flatten(M_6), PointTag=pt_4)  # -> simplify(flatten(Rules))
shift_2 = ShiftPaths(Data=ruleboundpt_2, Offset=-1)
clean_2 = CleanTree(RemoveNulls=True, RemoveInvalid=True, RemoveEmpty=invert(False), Tree=ruleboundpt_2)
lng_2 = ListLength(List=shift_2)
python_2 = GhPythonScript(r=simplify(ruleboundpt_3))  # -> SMN, SC, TMN, indifferent, TC
# ---------- python_2: Python ----------
__author__ = "mm1013"
__version__ = "2021.11.13"

import rhinoscriptsyntax as rs

try:
    SMN = r.Explicit.SourceModuleName
    SC = r.Explicit.SourceConnectorIndex
    TMN = r.Explicit.TargetModuleName
    indifferent = "indifferent"
    TC = r.Explicit.TargetConnectorIndex
except:
    SMN = None
    SC = None
    TMN = None
    indifferent = None
    TC = None
# ---------- end python_2 ----------
cull_3 = CullPattern(List=graft(M_6), CullPattern=lng_2)
python_3 = GhPythonScript(r=simplify(clean_2))  # -> SMN, SC, TMN, indifferent, TC; same code as python_2
ruleindiff = ConstructIndifferentRule(ModuleName=python_2.SMN, SourceConnectorIndex=python_2.SC)  # -> flatten(RuleIndifferent)
ruleindiff_2 = ConstructIndifferentRule(ModuleName=graft(cull_3), SourceConnectorIndex=python_3.SC)  # -> flatten(RuleIndifferent)
rulepreview_4 = PreviewRules(Modules=M_6, Rules=ruleindiff_2)
R_4 = Rule(ruleindiff)

# ---- group: Rules (continued)
R_5 = Rule(flatten([R_3, R, R_4, R_2]))
rulepreview_5 = PreviewRules(Modules=M_3, Rules=R_5)

# ---- group: Solver
module_2 = Module(flatten(construct_module))
rule = Rule(flatten(R_5))
slot = Slot(flatten(construct_slot_with_all_modules_allowed))
monoceros_wfc_solver = MonocerosWFCSolver(
    Slots=slot,
    Modules=module_2,
    Rules=rule,
    RandomSeed=Slider(35, range=0..100),
    MaxAttempts=Slider(479, range=0..1000),
    MaxObservations=2147483647,
    MaxTime="400",
    UseShannonEntropy=True)  # -> Out, Slots, Deterministic, Contradictory, Seed, Attempts, Observations
materialize_slots = MaterializeSlots(Modules=module_2, Slots=monoceros_wfc_solver.Slots)  # -> Geometry, Transform
panel_2 = Panel(monoceros_wfc_solver.Out)
preview = CustomPreview(Geometry=materialize_slots.Geometry, Material=ColourSwatch(SwatchColor=RGB(194, 194, 194)))

# ----
M_7 = Module(M_3)
txt = Text(R_2)
item_4 = ListItem(List=M_7, Index="55", Wrap=True)
tsort = SortText(Keys=txt, Culture=127)  # -> Keys, Values
panel_3 = Panel(item_4)
panel_4 = Panel(tsort.Keys)
rulepreview_6 = PreviewRules(Modules=M_7, Rules=R_5)

# ==== cluster GameBoard
B = ClusterInput()
debrep = DeconstructBrep(Brep=B)  # -> Faces, Edges, Vertices
F = ClusterInput()
item = ListItem(List=debrep.Faces, Index=Slider(4, range=0..5), Wrap=True)
Z = UnitZ(Factor=F)
multiplication = Multiplication(A=Z, B=0.99)
move = Move(Geometry=item, Motion=multiplication)  # -> Geometry, Transform
area = Area(Geometry=move.Geometry)  # -> Area, Centroid
scale_nu = ScaleNU(Geometry=move.Geometry, Plane=area.Centroid, ScaleX="1.4", ScaleY="1.4", ScaleZ=1)  # -> Geometry, Transform
Z_2 = UnitZ(Factor="-1")
extr = Extrude(Base=scale_nu.Geometry, Direction=Z_2)
preview = CustomPreview(Geometry=extr, Material=ColourSwatch(SwatchColor=RGB(128, 128, 128)))

# ==== cluster Cluster
B = ClusterInput()
B_2 = ClusterInput()
B_3 = ClusterInput()
dom = ConstructDomain(DomainStart=0, DomainEnd=B)
dom_2 = ConstructDomain(DomainStart=0, DomainEnd=B_2)
dom_3 = ConstructDomain(DomainStart=0, DomainEnd=B_3)
box = DomainBox(Base=PlaneXY(0, 0, 0), X=dom, Y=dom_2, Z=dom_3)
B_4 = ClusterOutput(box)

# ==== cluster Cluster_2
panel = Panel("""3
1""")
B = ClusterInput()
edges = BrepEdges(Brep=B)  # -> Naked, Interior, NonManifold
dash = DashPattern(Curve=edges.Interior, Pattern=panel)  # -> Dashes, Gaps
previewlw = CustomPreviewLineweights(Geometry=dash.Dashes, Shader=ColourSwatch(SwatchColor=RGB(250, 250, 250)), Absolute=False)

# ==== cluster Text
box = ClusterInput()
F = ClusterInput()
box_2 = Box(box)
Z = UnitZ(Factor=F)
box_3 = EvaluateBox(Box=box_2, UParameter=0.5, VParameter=0.5, WParameter=0.05)  # -> Plane, Point, Include
box_4 = EvaluateBox(Box=box_2, UParameter=0.5, VParameter=-0.1, WParameter=0.01)  # -> Plane, Point, Include
move = Move(Geometry=box_4.Plane, Motion=Z)  # -> Geometry, Transform
panel = Panel("""0
90
180
270""")
panel_2 = Panel("""Project GoldFinger
AEC Hackathon 2021
Copenhagen
Bloxhub""")
rotate = Rotate(Geometry=move.Geometry, Angle=degrees(panel), Plane=box_3.Plane)  # -> Geometry, Transform
tag = TextTag3D(Location=rotate.Geometry, Text=panel_2, Size="5", Colour=ColourSwatch(SwatchColor=RGB(255, 252, 204)), Justification=5)

# ==== cluster Cluster_3
C = ClusterInput()
prefix = ClusterInput()
prefix_2 = Text(prefix)
lng = ListLength(List=flatten(prefix_2))
series = Series(Start=0, Step=1, Count=lng)  # -> graft(Series)
cset = CreateSet(List=flatten(prefix_2))  # -> Set, Map
assign_paths = AssignPaths(InputData=flatten(series), PathsToAssign=flatten(cset.Map))  # -> flatten(RestructuredData)
assign_paths_2 = AssignPaths(InputData=flatten(prefix_2), PathsToAssign=flatten(cset.Map))
lng_2 = ListLength(List=assign_paths_2)
series_2 = Series(Start=0, Step=1, Count=lng_2)  # -> flatten(Series)
bbox = BoundingBox(Content=C, Plane=PlaneXY(0, 0, 0), UnionBox=True)  # -> Box, Box_2
sort = SortList(Keys=assign_paths, ValuesA=series_2)  # -> Keys, ValuesA
unflatten = UnflattenTree(Tree=sort.ValuesA, Guide=bbox.Box)
python = GhPythonScript(total_running=series, prefix=prefix_2, type_running=unflatten)  # -> out, module_name; inputs total_running: Int32, type_running: Int32
# ---------- python: Python ----------
__author__ = "mm1013"
__version__ = "2021.11.13"


module_name = ("%s" % int(total_running)).ljust(3) + prefix + ("%s" % int(type_running)).rjust(2)

module_name = '{0:03} {1} {2:02}'.format(total_running, prefix, type_running)
# ---------- end python ----------
module_name = ClusterOutput(python.module_name)

# ==== cluster Cluster_4
content = ClusterInput()
bounding_box = BoundingBox(Content=content, Plane=PlaneXY(0, 0, 0))  # -> Box, Box_2
box_properties = BoxProperties(Box=bounding_box.Box)  # -> Center, Diagonal, Area, Volume, Degeneracy
center = ClusterOutput(box_properties.Center)

# ==== cluster Cluster_5
V = ClusterInput()
vlen = VectorLength(Vector=V)
item = ListItem(List=vlen, Index=0, Wrap=True)
i = ClusterOutput(item)

# ==== cluster Cluster_6
C = ClusterInput()
bbox = BoundingBox(Content=C, Plane=PlaneXY(0, 0, 0), UnionBox=True)  # -> Box, Box_2
box_properties = BoxProperties(Box=bbox.Box)  # -> Center, Diagonal, Area, Volume, Degeneracy
scale = Scale(Geometry=bbox.Box, Center=box_properties.Center, Factor="1.1")  # -> Geometry, Transform
color = ClusterInput()
edges = BrepEdges(Brep=scale.Geometry)  # -> Naked, Interior, NonManifold
dc = DrawCurves(Curves=flatten(edges.Interior), Color=color)  # inputs Curves: list of Polyline, Color: Color
#   port Curves: Curves to render {list,curve}
# ---------- dc: Python ----------
ghenv.Component.Name = "DrawCurves"
ghenv.Component.NickName = "DC"

from ghpythonlib.componentbase import executingcomponent as component
import Rhino as rc
import System
import re
import math



class MyComponent(component):
    
    def RunScript(self,Curves, Color):
        self.curves = Curves

        self.color = Color
        
        self.pls = []
        for crv in self.curves:
            
            self.pls.append(crv)
            #self.pls.append(crv.ToPolyline(rc.RhinoDoc.ActiveDoc.ModelAbsoluteTolerance,
            #rc.RhinoDoc.ActiveDoc.ModelAngleToleranceRadians,
            #self.threshold/10,
            #self.threshold).ToPolyline())
 

    def DrawViewportWires(self,arg):
        

        for pl in self.pls:

            
            arg.Display.DrawDottedPolyline(pl, self.color, True)
            #arg.Display.DrawDottedLine(pl, self.color)
        #edges = srf.Edges
        
        #for edge in edges:
        #
# ---------- end dc ----------

# ==== cluster MeshIt: Meshes everything in the input. Graft the input if you want to make several meshes, otherwise returns a joined mesh.
mesh_brep = ClusterInput()
mesh_brep_2 = Geometry(simplify(mesh_brep))
tmatch = MatchText(Text=mesh_brep_2, RegEx="(mesh)", Case=False)
tmatch_2 = MatchText(Text=mesh_brep_2, RegEx="(brep)|(polysurface)|(surface)|(extrusion)", Case=False)
group = Group(Objects=mesh_brep_2)
cull = CullPattern(List=mesh_brep_2, CullPattern=tmatch_2)
cull_2 = CullPattern(List=mesh_brep_2, CullPattern=tmatch)
mesh = MeshBrep(
    Brep=cull,
    Settings={GridMaxCount=0, GridMinCount=16, JaggedSeams=False, MaxEdgeLength=0, MinEdgeLength=0.0001, MinTolerance=0, Refine=True, RefineAngle=0, RelativeTolerance=0.65, SimplePlanes=True, Tolerance=0})

# ----
# Fix invalid mesh
panel = Panel("Invalid Mesh")
mesh_2 = Mesh(mesh)
tmatch_3 = MatchText(Text=mesh_2, RegEx=panel, Case=False)
unweave = Unweave(List=mesh_2, UnweavePattern=tmatch_3)  # -> Data0, Data1
explode = MeshExplode(Mesh=unweave.Data1, Interpolate=False)  # -> simplify(Faces)
abc_a = ABC(data=explode)
num = Number("0")
area = MeshArea(Mesh=abc_a)  # -> Area, Centroid
equals = Equality(FirstNumber=area.Area, SecondNumber=num)  # -> Equality, Inequality
cull_3 = CullPattern(List=abc_a, CullPattern=equals.Inequality)

lng = ListLength(List=flatten(unweave.Data1))
bool = Boolean(lng)

# ----
# Fix invalid mesh
panel_2 = Panel("Invalid Mesh")
mesh_3 = Mesh(cull_2)
tmatch_4 = MatchText(Text=mesh_3, RegEx=panel_2, Case=False)
unweave_2 = Unweave(List=mesh_3, UnweavePattern=tmatch_4)  # -> Data0, Data1
explode_2 = MeshExplode(Mesh=unweave_2.Data1, Interpolate=False)  # -> simplify(Faces)
abc_a_2 = ABC(data=explode_2)
num_2 = Number("0")
area_2 = MeshArea(Mesh=abc_a_2)  # -> Area, Centroid
equals_2 = Equality(FirstNumber=area_2.Area, SecondNumber=num_2)  # -> Equality, Inequality
cull_4 = CullPattern(List=abc_a_2, CullPattern=equals_2.Inequality)

lng_2 = ListLength(List=flatten(unweave_2.Data1))
bool_2 = Boolean(lng_2)
filter = StreamFilter(Gate=bool_2, Stream1=cull_4)
filter_2 = StreamFilter(Gate=bool, Stream1=cull_4)

mjoin = MeshJoin(Meshes=[unweave.Data0, filter_2])

mjoin_2 = MeshJoin(Meshes=[unweave_2.Data0, filter])

abc_a_3 = ABC(data=mjoin)
abc_a_4 = ABC(data=mjoin_2)
abc_ab = ABCAB(data=mjoin)
abc_ab_2 = ABCAB(data=mjoin_2)
clean = CleanTree(RemoveNulls=True, RemoveInvalid=True, RemoveEmpty=False, Tree=[abc_ab, abc_ab_2])
mjoin_3 = MeshJoin(Meshes=clean)
unflatten = UnflattenTree(Tree=mjoin_3, Guide=group)
panel_3 = Panel(mjoin_3)
mesh_joined = Mesh(unflatten)
mesh_joined_2 = ClusterOutput(mesh_joined)

# ==== cluster ABC
data = ClusterInput()
data_2 = Data(data)
path_mapper = PathMapper(
    data_2,
    source=["{A;B;C;D;E;F;G}", "{A;B;C;D;E;F}", "{A;B;C;D;E}", "{A;B;C;D}", "{A;B;C}", "{A;B}", "{A}"],
    target=["{A}", "{A}", "{A}", "{A}", "{A}", "{A}", "{A}"])
data_3 = Data(path_mapper)
data_4 = ClusterOutput(data_3)

# ==== cluster ABCAB
data = ClusterInput()
data_2 = Data(data)
path_mapper = PathMapper(
    data_2,
    source=["{A;B;C;D;E;F;G}", "{A;B;C;D;E;F}", "{A;B;C;D;E}", "{A;B;C;D}", "{A;B;C}", "{A;B}", "{A}"],
    target=["{A;B}", "{A;B}", "{A;B}", "{A;B}", "{A;B}", "{A;B}", "{A}"])
viewer = ParamViewer(data_2)
data_3 = Data(path_mapper)
data_4 = ClusterOutput(data_3)
