# Grasshopper definition 211113-WFC-BASE.gh (Grasshopper 1.0.7)
# Copyright: 2021
# Copyright: 2021-13-26
# plug-ins: Monoceros, HDTTreeUtils, Human

xy = XYPlane(Origin=Point(0, 0, 0))
xy_2 = XYPlane(Origin=xy)

# ---- group: Modules
layers = Panel("""Walls
Floors
Roofs""")
layers_2 = Panel("Base::Cages")
expression = Expression(layer=layers, Expression="Format(\"Base::{0}::Surfaces\", layer)")
dpipeline = DynamicGeometryPipeline(
    LayerFilter=expression,
    TypeFilter="All",
    NameFilter="*",
    GroupByLayer=False,
    GroupByType=False,
    IncludeHidden=True,
    IncludeLocked=True,
    enableFullPath=True,
    listenToAttributes=True)  # -> simplify(GeometryOut)
dpipeline_2 = DynamicGeometryPipeline(
    LayerFilter=layers_2,
    TypeFilter="All",
    NameFilter="*",
    GroupByLayer=False,
    GroupByType=False,
    IncludeHidden=True,
    IncludeLocked=True,
    enableFullPath=True,
    listenToAttributes=True)  # -> simplify(GeometryOut)
box_properties = BoxProperties(Box=dpipeline_2)  # -> Center, Diagonal, Area, Volume, Degeneracy

# ----
lng = ListLength(List=dpipeline)
clean = CleanTree(RemoveNulls=True, RemoveInvalid=True, RemoveEmpty=True, Tree=dpipeline)
cull = CullPattern(List=layers, CullPattern=flatten(lng))

# ---- group: Modules (continued)
cluster = Cluster_2(content=clean)
long = LongestList(ListA=graft(cull), ListB=clean, PaddingMode=2)  # -> ListA, ListB

# ---- group: Modules / matching close
cluster_2 = Cluster_3(V=box_properties.Diagonal)
rtreematch = RTreeMatch(geoCenters=cluster, cageCenters=box_properties.Center, threshold=cluster_2)  # -> closestCagePerGeo; inputs geoCenters: list of Point3d, cageCenters: list of Point3d, threshold: Double
# ---------- rtreematch: C# usings ----------
using System.Linq;
using System.Threading.Tasks;
# ---------- rtreematch: C# ----------
    Component.Name = Component.NickName = "rTreeMatch";
    Component.Description = "Matching Points with RTree\nAuthor Mathias Sønderskov Schaltz 2021";
    Component.Category = "User";
    Component.SubCategory = "List";

    Component.IconDisplayMode = GH_IconDisplayMode.name;

    Component.Params.Input[0].Description = "Set A to match";

    Component.Params.Input[1].Description = "Set B to match";

    Component.Params.Input[2].Description = "threshold in document units";




    Component.Params.Output[0].Description = "Index of Set B that is closest to point in Set B";
    
   
   
   
   
   
    RTree rTree = new RTree();
    List<List<int>> potentialCagesPerGeometry = new List<List<int>>();

    int[] closestCagePerGeometry = Populate(new int[geoCenters.Count], -1);

    for (int i = 0; i < geoCenters.Count; i++)
    {
      potentialCagesPerGeometry.Add(new List<int>());
    }


    for (int i = 0; i < cageCenters.Count; i++)
    {
      rTree.Insert(cageCenters[i], i);
    }


    for (int i = 0; i < geoCenters.Count; i++)
    {
      rTree.Search(
        new Sphere(geoCenters[i], threshold),
        (sender, args) => {potentialCagesPerGeometry[i].Add(args.Id); });
    }

    for (int i = 0; i < potentialCagesPerGeometry.Count; i++)
    {
      potentialCagesPerGeometry[i] = potentialCagesPerGeometry[i].Distinct().ToList();
    }

    Parallel.For(0, geoCenters.Count, i =>
      {
      double dist = double.MaxValue;

      if (potentialCagesPerGeometry.Count > 0)
      {
        for (int j = 0; j < potentialCagesPerGeometry[i].Count; j++)
        {


          Point3d target = cageCenters[potentialCagesPerGeometry[i][j]];

          double distance = geoCenters[i].DistanceTo(target);

          if (distance < dist)
          {
            closestCagePerGeometry[i] = potentialCagesPerGeometry[i][j];
            dist = distance;
          }
        }
      }
      });



    closestCagePerGeo = closestCagePerGeometry;
# ---------- rtreematch: C# additional code ----------
  public static T[] Populate<T>(T[] arr, T value)
  {
  for (int i = 0; i < arr.Length; i++)
  {
  arr[i] = value;
}

        return arr;
  }
# ---------- end rtreematch ----------

# ---- group: Modules (continued)
item = ListItem(List=box_properties.Center, Index=rtreematch, Wrap=False)
assign_paths = AssignPaths(InputData=flatten(dpipeline), PathsToAssign=flatten(rtreematch))
assign_paths_2 = AssignPaths(InputData=flatten(item), PathsToAssign=flatten(rtreematch))
assign_paths_3 = AssignPaths(InputData=flatten(long.ListA), PathsToAssign=flatten(rtreematch))
item_2 = ListItem(List=assign_paths_3, Index=0, Wrap=True)
item_3 = ListItem(List=assign_paths_2, Index=0, Wrap=True)

geometries = Geometry(assign_paths)
prefix = Text(item_2)
cagecenter = Point(item_3)

# ---- group: preview
cluster_3 = Cluster_4(C=[geometries, cagecenter], color=ColourSwatch(SwatchColor=RGB(255, 255, 255)))

# ---- group: Modules (continued)
cluster_4 = Cluster(prefix=prefix, C=geometries)  # -> simplify(module_name)
construct_module = ConstructModule(ModuleName=cluster_4, ModulePartPoints=cagecenter, Geometry=geometries, BasePlane=xy_2, ModulePartDiagonal="3.6,3.6,4.2")  # -> flatten(Module)

# ---- group: Rules
M = Module(construct_module)
geometry_pipeline = GeometryPipeline(
    GroupByLayer=False,
    GroupByType=False,
    IncludeHidden=True,
    IncludeLocked=True,
    LayerFilter="BoundaryPoints::Points",
    NameFilter="*",
    SublayerFiltering=True,
    TypeFilter=1)
geometry_pipeline_2 = GeometryPipeline(
    GroupByLayer=False,
    GroupByType=False,
    IncludeHidden=True,
    IncludeLocked=True,
    LayerFilter="Lines",
    NameFilter="*",
    SublayerFiltering=True,
    TypeFilter=1073741852)
deconmodule = DeconstructModule(Module=M)  # -> flatten(ModuleName), ModulePartCenterPoints, Geometry, BasePlane, ModulePartDiagonal, IsCompact, IsValid, Connectors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
pt = Point(geometry_pipeline)
crv = Curve(geometry_pipeline_2)
ruleexpcrv = ExplicitRuleFromCurve(Modules=M, ConnectionCurve=crv)  # -> flatten(Rules)
R = Rule(flatten(ruleexpcrv))
ruleindiffunused = IndifferentRulesForUnusedConnectors(Module=M, Rules=flatten(R))
deconruletyp = DeconstructTypedRule(Rule=ruleindiffunused)  # -> ModuleName, ConnectorIndex, Type
rulebound = ConstructRuleAtBoundary(Module=graft(M), ConnectorIndex=deconruletyp.ConnectorIndex)
R_2 = Rule(flatten([R, ruleindiffunused]))
rulepreview = PreviewRules(Modules=M, Rules=R_2)

# ---- group: Slots
geometry = Geometry(<brep referenced from the Rhino model>)
diagonal = Text("3.6,3.6,4.2")
pln = Plane(xy_2)
slice_geometry = SliceGeometry(Geometry=geometry, BasePlane=pln, GridSlotDiagonal=diagonal, FillMethod=Slider(0, range=0..3), Precision=0.5)
pt_2 = Point(slice_geometry)
M_2 = Module(M)
diagonal_2 = Text("3.6,3.6,4.2")
pln_2 = Plane(xy_2)
pt_3 = Point([<point referenced from the Rhino model> x280])
construct_slot_with_listed_modules_allow = ConstructSlotWithListedModulesAllowed(SlotPoint=pt_2, BasePlane=pln_2, GridSlotDiagonal=diagonal_2, AllowedModuleNames=M_2, Modules=M_2)

# ----
ruleboundpt = RuleAtBoundaryFromPoint(Modules=flatten(M), PointTag=pt)  # -> flatten(Rules)
rulepreview_2 = PreviewRules(Modules=M, Rules=ruleboundpt)
rulepreview_3 = PreviewRules(Modules=M, Rules=ruleexpcrv)

# ---- group: Solver
module = Module(flatten(M))
rule = Rule(flatten(R_2))
slot = Slot(flatten(construct_slot_with_listed_modules_allow))
monoceros_wfc_solver = MonocerosWFCSolver(
    Slots=slot,
    Modules=module,
    Rules=rule,
    RandomSeed=Slider(20, range=0..100),
    MaxAttempts=Slider(479, range=0..1000),
    MaxObservations=2147483647,
    MaxTime="3000",
    UseShannonEntropy=True)  # -> Out, Slots, Deterministic, Contradictory, Seed, Attempts, Observations
materialize_slots = MaterializeSlots(Modules=module, Slots=monoceros_wfc_solver.Slots)  # -> Geometry, Transform
panel = Panel(monoceros_wfc_solver.Out)
preview = CustomPreview(Geometry=materialize_slots.Geometry, Material=ColourSwatch(SwatchColor=RGB(194, 194, 194)))

# ==== cluster Cluster
C = ClusterInput()
prefix = ClusterInput()
prefix_2 = Text(prefix)
lng = ListLength(List=flatten(prefix_2))
series = Series(Start=0, Step=1, Count=lng)  # -> graft(Series)
cset = CreateSet(List=flatten(prefix_2))  # -> Set, Map
assign_paths = AssignPaths(InputData=flatten(series), PathsToAssign=flatten(cset.Map))  # -> flatten(RestructuredData)
assign_paths_2 = AssignPaths(InputData=flatten(prefix_2), PathsToAssign=flatten(cset.Map))
lng_2 = ListLength(List=assign_paths_2)
series_2 = Series(Start=0, Step=1, Count=lng_2)  # -> flatten(Series)
bbox = BoundingBox(Content=C, Plane=PlaneXY(0, 0, 0), UnionBox=True)  # -> Box, Box_2
sort = SortList(Keys=assign_paths, ValuesA=series_2)  # -> Keys, ValuesA
unflatten = UnflattenTree(Tree=sort.ValuesA, Guide=bbox.Box)
python = GhPythonScript(total_running=series, prefix=prefix_2, type_running=unflatten)  # -> out, module_name; inputs total_running: Int32, type_running: Int32
# ---------- python: Python ----------
__author__ = "mm1013"
__version__ = "2021.11.13"


module_name = ("%s" % int(total_running)).ljust(3) + prefix + ("%s" % int(type_running)).rjust(2)

module_name = '{0:03} {1} {2:02}'.format(total_running, prefix, type_running)
# ---------- end python ----------
module_name = ClusterOutput(python.module_name)

# ==== cluster Cluster_2
content = ClusterInput()
bounding_box = BoundingBox(Content=content, Plane=PlaneXY(0, 0, 0))  # -> Box, Box_2
box_properties = BoxProperties(Box=bounding_box.Box)  # -> Center, Diagonal, Area, Volume, Degeneracy
center = ClusterOutput(box_properties.Center)

# ==== cluster Cluster_3
V = ClusterInput()
vlen = VectorLength(Vector=V)
item = ListItem(List=vlen, Index=0, Wrap=True)
i = ClusterOutput(item)

# ==== cluster Cluster_4
C = ClusterInput()
bbox = BoundingBox(Content=C, Plane=PlaneXY(0, 0, 0), UnionBox=True)  # -> Box, Box_2
box_properties = BoxProperties(Box=bbox.Box)  # -> Center, Diagonal, Area, Volume, Degeneracy
scale = Scale(Geometry=bbox.Box, Center=box_properties.Center, Factor="1.1")  # -> Geometry, Transform
color = ClusterInput()
edges = BrepEdges(Brep=scale.Geometry)  # -> Naked, Interior, NonManifold
dc = DrawCurves(Curves=flatten(edges.Interior), Color=color)  # inputs Curves: list of Polyline, Color: Color
#   port Curves: Curves to render {list,curve}
# ---------- dc: Python ----------
ghenv.Component.Name = "DrawCurves"
ghenv.Component.NickName = "DC"

from ghpythonlib.componentbase import executingcomponent as component
import Rhino as rc
import System
import re
import math



class MyComponent(component):
    
    def RunScript(self,Curves, Color):
        self.curves = Curves

        self.color = Color
        
        self.pls = []
        for crv in self.curves:
            
            self.pls.append(crv)
            #self.pls.append(crv.ToPolyline(rc.RhinoDoc.ActiveDoc.ModelAbsoluteTolerance,
            #rc.RhinoDoc.ActiveDoc.ModelAngleToleranceRadians,
            #self.threshold/10,
            #self.threshold).ToPolyline())
 

    def DrawViewportWires(self,arg):
        

        for pl in self.pls:

            
            arg.Display.DrawDottedPolyline(pl, self.color, True)
            #arg.Display.DrawDottedLine(pl, self.color)
        #edges = srf.Edges
        
        #for edge in edges:
        #
# ---------- end dc ----------
