# Grasshopper definition goldfinger3.gh (Grasshopper 1.0.7)
# Copyright: 2021-25-30
# Copyright: 2021
# Copyright: 2021-13-26
# plug-ins: InteractiveTownBuilder, Monoceros, HDTTreeUtils, Human

number_slider = Slider(55, range=0..500)
cluster = Cluster_2(B=number_slider, B_2=number_slider, B_3=Slider(33, range=0..500))

# ----
# Goldfinger
number_slider_2 = Slider(4.2, range=2..6)
# Project Goldfinger
number_slider_3 = Slider(3.6, range=2..6)
itb = InteractiveTownBuilder(
    BoundingBox=cluster,
    XSize=number_slider_3,
    YSize=number_slider_3,
    ZSize=number_slider_2,
    Enable=Toggle(False),
    Reset=Button(),
    AllowCantilever=Toggle(True))  # -> Slots, Boxes, Model
# AEC Hackathon 2021
cluster_2 = Cluster(B=cluster, F=number_slider_2)

cluster_3 = Cluster_3(B=cluster)
cluster_4 = Cluster_4(F=number_slider_2, box=cluster)

python = GhPythonScript(model=itb.Model)  # -> out, boxesMesh
# ---------- python: Python ----------
__author__ = "mm1013"
__version__ = "2021.10.31"

import rhinoscriptsyntax as rs
import ghpythonlib as ghp

boxesMesh = [model.GetFaces(vox) for vox in model.Voxels if vox.Z !=0]


boxesMesh = ghp.treehelpers.list_to_tree(boxesMesh)
# ---------- end python ----------
mjoin = MeshJoin(Meshes=python.boxesMesh)
area = Area(Geometry=mjoin)  # -> Area, Centroid
pt = Point(flatten(area.Centroid))

# ---- group: diagonal
xy = XYPlane(Origin=Point(0, 0, 0))
xy_2 = XYPlane(Origin=Point(1.8, 1.8, -2.1))
pt_2 = ConstructPoint(XCoordinate=number_slider_3, YCoordinate=number_slider_3, ZCoordinate=number_slider_2)
pln = Plane(xy)
move = Move(Geometry=pln, Motion=expr("x*0.5", pt_2))  # -> Geometry, Transform
diagonal = Vector(pt_2)

# ----
construct_slot_with_all_modules_allowed = ConstructSlotWithAllModulesAllowed(SlotPoint=pt, BasePlane=move.Geometry, GridSlotDiagonal=pt_2)
slots = Slot(construct_slot_with_all_modules_allowed)

# ----
# preview slots
S = Slot(construct_slot_with_all_modules_allowed)

xy_3 = XYPlane(Origin=Point(0, 0, 0))
xy_4 = XYPlane(Origin=xy_3)

geometry_pipeline = GeometryPipeline(
    GroupByLayer=False,
    GroupByType=False,
    IncludeHidden=True,
    IncludeLocked=True,
    LayerFilter="Indifferent",
    NameFilter="*",
    SublayerFiltering=True,
    TypeFilter=1)
pt_3 = Point(geometry_pipeline)
collectrules = CollectRules()

# ---- group: Modules
layers = Panel("""Walls
Floors
Roofs""")
layers_2 = Panel("Base::Cages")
expression = Expression(layer=layers, Expression="Format(\"Base::{0}::Surfaces\", layer)")
dpipeline = DynamicGeometryPipeline(
    LayerFilter=expression,
    TypeFilter="All",
    NameFilter="*",
    GroupByLayer=False,
    GroupByType=False,
    IncludeHidden=True,
    IncludeLocked=True,
    enableFullPath=True,
    listenToAttributes=True)  # -> simplify(GeometryOut)
dpipeline_2 = DynamicGeometryPipeline(
    LayerFilter=layers_2,
    TypeFilter="All",
    NameFilter="*",
    GroupByLayer=False,
    GroupByType=False,
    IncludeHidden=True,
    IncludeLocked=True,
    enableFullPath=True,
    listenToAttributes=True)  # -> simplify(GeometryOut)
box_properties = BoxProperties(Box=dpipeline_2)  # -> Center, Diagonal, Area, Volume, Degeneracy

# ----
lng = ListLength(List=dpipeline)
clean = CleanTree(RemoveNulls=True, RemoveInvalid=True, RemoveEmpty=True, Tree=dpipeline)
cull = CullPattern(List=layers, CullPattern=flatten(lng))

# ---- group: Modules (continued)
cluster_5 = Cluster_6(content=clean)
long = LongestList(ListA=graft(cull), ListB=clean, PaddingMode=2)  # -> ListA, ListB

# ---- group: Modules / matching close
cluster_6 = Cluster_7(V=box_properties.Diagonal)
rtreematch = RTreeMatch(geoCenters=cluster_5, cageCenters=box_properties.Center, threshold=cluster_6)  # -> closestCagePerGeo; inputs geoCenters: list of Point3d, cageCenters: list of Point3d, threshold: Double
# ---------- rtreematch: C# usings ----------
using System.Linq;
using System.Threading.Tasks;
# ---------- rtreematch: C# ----------
    Component.Name = Component.NickName = "rTreeMatch";
    Component.Description = "Matching Points with RTree\nAuthor Mathias Sønderskov Schaltz 2021";
    Component.Category = "User";
    Component.SubCategory = "List";

    Component.IconDisplayMode = GH_IconDisplayMode.name;

    Component.Params.Input[0].Description = "Set A to match";

    Component.Params.Input[1].Description = "Set B to match";

    Component.Params.Input[2].Description = "threshold in document units";




    Component.Params.Output[0].Description = "Index of Set B that is closest to point in Set B";
    
   
   
   
   
   
    RTree rTree = new RTree();
    List<List<int>> potentialCagesPerGeometry = new List<List<int>>();

    int[] closestCagePerGeometry = Populate(new int[geoCenters.Count], -1);

    for (int i = 0; i < geoCenters.Count; i++)
    {
      potentialCagesPerGeometry.Add(new List<int>());
    }


    for (int i = 0; i < cageCenters.Count; i++)
    {
      rTree.Insert(cageCenters[i], i);
    }


    for (int i = 0; i < geoCenters.Count; i++)
    {
      rTree.Search(
        new Sphere(geoCenters[i], threshold),
        (sender, args) => {potentialCagesPerGeometry[i].Add(args.Id); });
    }

    for (int i = 0; i < potentialCagesPerGeometry.Count; i++)
    {
      potentialCagesPerGeometry[i] = potentialCagesPerGeometry[i].Distinct().ToList();
    }

    Parallel.For(0, geoCenters.Count, i =>
      {
      double dist = double.MaxValue;

      if (potentialCagesPerGeometry.Count > 0)
      {
        for (int j = 0; j < potentialCagesPerGeometry[i].Count; j++)
        {


          Point3d target = cageCenters[potentialCagesPerGeometry[i][j]];

          double distance = geoCenters[i].DistanceTo(target);

          if (distance < dist)
          {
            closestCagePerGeometry[i] = potentialCagesPerGeometry[i][j];
            dist = distance;
          }
        }
      }
      });



    closestCagePerGeo = closestCagePerGeometry;
# ---------- rtreematch: C# additional code ----------
  public static T[] Populate<T>(T[] arr, T value)
  {
  for (int i = 0; i < arr.Length; i++)
  {
  arr[i] = value;
}

        return arr;
  }
# ---------- end rtreematch ----------

# ---- group: Modules (continued)
item = ListItem(List=box_properties.Center, Index=rtreematch, Wrap=False)
assign_paths = AssignPaths(InputData=flatten(dpipeline), PathsToAssign=flatten(rtreematch))
assign_paths_2 = AssignPaths(InputData=flatten(item), PathsToAssign=flatten(rtreematch))
assign_paths_3 = AssignPaths(InputData=flatten(long.ListA), PathsToAssign=flatten(rtreematch))
item_2 = ListItem(List=assign_paths_3, Index=0, Wrap=True)
item_3 = ListItem(List=assign_paths_2, Index=0, Wrap=True)

geometries = Geometry(assign_paths)
prefix = Text(item_2)
cagecenter = Point(item_3)

# ---- group: preview
cluster_7 = Cluster_8(C=[geometries, cagecenter], color=ColourSwatch(SwatchColor=RGB(255, 255, 255)))

# ---- group: Modules (continued)
cluster_8 = Cluster_5(prefix=prefix, C=geometries)  # -> simplify(module_name)
construct_module = ConstructModule(ModuleName=cluster_8, ModulePartPoints=cagecenter, Geometry=geometries, BasePlane=xy_4, ModulePartDiagonal="3.6,3.6,4.2")  # -> flatten(Module)

# ----
M = Module(construct_module)

# ---- group: Rules
M_2 = Module(construct_module)
geometry_pipeline_2 = GeometryPipeline(
    GroupByLayer=False,
    GroupByType=False,
    IncludeHidden=True,
    IncludeLocked=True,
    LayerFilter="Lines",
    NameFilter="*",
    SublayerFiltering=True,
    TypeFilter=1073741852)
deconmodule = DeconstructModule(Module=M_2)  # -> flatten(ModuleName), ModulePartCenterPoints, Geometry, BasePlane, ModulePartDiagonal, IsCompact, IsValid, Connectors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
crv = Curve(geometry_pipeline_2)
ruleexpcrv = ExplicitRuleFromCurve(Modules=M, ConnectionCurve=crv)  # -> flatten(Rules)
R = Rule(flatten(ruleexpcrv))
ruleindiffunused = IndifferentRulesForUnusedConnectors(Module=M_2, Rules=flatten(R))
deconruletyp = DeconstructTypedRule(Rule=ruleindiffunused)  # -> ModuleName, ConnectorIndex, Type
rulebound = ConstructRuleAtBoundary(Module=graft(M_2), ConnectorIndex=deconruletyp.ConnectorIndex)

# ----
geometry_pipeline_3 = GeometryPipeline(
    GroupByLayer=False,
    GroupByType=False,
    IncludeHidden=True,
    IncludeLocked=True,
    LayerFilter="Out",
    NameFilter="*",
    SublayerFiltering=True,
    TypeFilter=1)
pt_4 = Point(geometry_pipeline_3)
M_3 = Module(construct_module)
ruleboundpt = RuleAtBoundaryFromPoint(Modules=flatten(M_3), PointTag=pt_4)  # -> flatten(Rules)
rulepreview = PreviewRules(Modules=M_2, Rules=ruleboundpt)
R_2 = Rule(ruleboundpt)

M_4 = Module(M_2)
ruleboundpt_2 = RuleAtBoundaryFromPoint(Modules=graft(M_4), PointTag=pt_3)  # -> simplify(Rules)
ruleboundpt_3 = RuleAtBoundaryFromPoint(Modules=flatten(M_4), PointTag=pt_3)  # -> simplify(flatten(Rules))
rulepreview_2 = PreviewRules(Modules=M, Rules=ruleexpcrv)

# ---- group: Slots
geometry = Geometry(<brep referenced from the Rhino model>)
diagonal_2 = Text("3.6,3.6,4.2")
pln_2 = Plane(xy_4)
slice_geometry = SliceGeometry(Geometry=geometry, BasePlane=pln_2, GridSlotDiagonal=diagonal_2, FillMethod=Slider(0, range=0..3), Precision=0.5)
pt_5 = Point([<point referenced from the Rhino model> x280])
M_5 = Module(M_2)
diagonal_3 = Text("3.6,3.6,4.2")
pln_3 = Plane(xy_4)
construct_slot_with_listed_modules_allow = ConstructSlotWithListedModulesAllowed(SlotPoint=slice_geometry, BasePlane=pln_3, GridSlotDiagonal=diagonal_3, AllowedModuleNames=M_5, Modules=M_5)

# ----
abc_a = ABC(data=ruleboundpt_2)
clean_2 = CleanTree(RemoveNulls=True, RemoveInvalid=True, RemoveEmpty=invert(False), Tree=ruleboundpt_2)
lng_2 = ListLength(List=abc_a)
python_2 = GhPythonScript(r=simplify(ruleboundpt_3))  # -> SMN, SC, TMN, indifferent, TC
# ---------- python_2: Python ----------
__author__ = "mm1013"
__version__ = "2021.11.13"

import rhinoscriptsyntax as rs

try:
    SMN = r.Explicit.SourceModuleName
    SC = r.Explicit.SourceConnectorIndex
    TMN = r.Explicit.TargetModuleName
    indifferent = "indifferent"
    TC = r.Explicit.TargetConnectorIndex
except:
    SMN = None
    SC = None
    TMN = None
    indifferent = None
    TC = None
# ---------- end python_2 ----------
cull_2 = CullPattern(List=graft(M_4), CullPattern=lng_2)
python_3 = GhPythonScript(r=simplify(clean_2))  # -> SMN, SC, TMN, indifferent, TC; same code as python_2
ruleindiff = ConstructIndifferentRule(ModuleName=python_2.SMN, SourceConnectorIndex=python_2.SC)  # -> flatten(RuleIndifferent)
ruleindiff_2 = ConstructIndifferentRule(ModuleName=graft(cull_2), SourceConnectorIndex=python_3.SC)  # -> flatten(RuleIndifferent)
rulepreview_3 = PreviewRules(Modules=M_4, Rules=ruleindiff_2)
R_3 = Rule(ruleindiff)
panel = Panel(rulebound)
panel_2 = Panel(ruleindiffunused)

# ---- group: Rules (continued)
R_4 = Rule(flatten([R_2, R, R_3]))
rulepreview_4 = PreviewRules(Modules=M_2, Rules=R_4)

# ---- group: Solver
module = Module(flatten(M_2))
rule = Rule(flatten(R_4))
slot = Slot(flatten(slots))
monoceros_wfc_solver = MonocerosWFCSolver(
    Slots=slot,
    Modules=module,
    Rules=rule,
    RandomSeed=Slider(20, range=0..100),
    MaxAttempts=Slider(479, range=0..1000),
    MaxObservations=2147483647,
    MaxTime="3000",
    UseShannonEntropy=True)  # -> Out, Slots, Deterministic, Contradictory, Seed, Attempts, Observations
materialize_slots = MaterializeSlots(Modules=module, Slots=monoceros_wfc_solver.Slots)  # -> Geometry, Transform
panel_3 = Panel(monoceros_wfc_solver.Out)
preview = CustomPreview(Geometry=materialize_slots.Geometry, Material=ColourSwatch(SwatchColor=RGB(194, 194, 194)))

# ==== cluster Cluster
B = ClusterInput()
debrep = DeconstructBrep(Brep=B)  # -> Faces, Edges, Vertices
F = ClusterInput()
item = ListItem(List=debrep.Faces, Index=Slider(4, range=0..5), Wrap=True)
Z = UnitZ(Factor=F)
multiplication = Multiplication(A=Z, B=0.99)
move = Move(Geometry=item, Motion=multiplication)  # -> Geometry, Transform
area = Area(Geometry=move.Geometry)  # -> Area, Centroid
scale_nu = ScaleNU(Geometry=move.Geometry, Plane=area.Centroid, ScaleX="1.4", ScaleY="1.4", ScaleZ=1)  # -> Geometry, Transform
Z_2 = UnitZ(Factor="-1")
extr = Extrude(Base=scale_nu.Geometry, Direction=Z_2)
preview = CustomPreview(Geometry=extr, Material=ColourSwatch(SwatchColor=RGB(128, 128, 128)))

# ==== cluster Cluster_2
B = ClusterInput()
B_2 = ClusterInput()
B_3 = ClusterInput()
dom = ConstructDomain(DomainStart=0, DomainEnd=B)
dom_2 = ConstructDomain(DomainStart=0, DomainEnd=B_2)
dom_3 = ConstructDomain(DomainStart=0, DomainEnd=B_3)
box = DomainBox(Base=PlaneXY(0, 0, 0), X=dom, Y=dom_2, Z=dom_3)
B_4 = ClusterOutput(box)

# ==== cluster Cluster_3
panel = Panel("""6
10""")
B = ClusterInput()
edges = BrepEdges(Brep=B)  # -> Naked, Interior, NonManifold
dash = DashPattern(Curve=edges.Interior, Pattern=panel)  # -> Dashes, Gaps
previewlw = CustomPreviewLineweights(Geometry=dash.Dashes, Shader=ColourSwatch(SwatchColor=RGB(56, 56, 56)), Absolute=False)

# ==== cluster Cluster_4
box = ClusterInput()
F = ClusterInput()
box_2 = Box(box)
Z = UnitZ(Factor=F)
box_3 = EvaluateBox(Box=box_2, UParameter=0.5, VParameter=0.5, WParameter=0.05)  # -> Plane, Point, Include
box_4 = EvaluateBox(Box=box_2, UParameter=0.5, VParameter=-0.1, WParameter=0.01)  # -> Plane, Point, Include
move = Move(Geometry=box_4.Plane, Motion=Z)  # -> Geometry, Transform
panel = Panel("""0
90
180
270""")
panel_2 = Panel("""Project GoldFinger
AEC Hackathon 2021
Copenhagen
Bloxhub""")
rotate = Rotate(Geometry=move.Geometry, Angle=degrees(panel), Plane=box_3.Plane)  # -> Geometry, Transform
tag = TextTag3D(Location=rotate.Geometry, Text=panel_2, Size="5", Colour=ColourSwatch(SwatchColor=RGB(138, 138, 138)), Justification=5)

# ==== cluster Cluster_5
C = ClusterInput()
prefix = ClusterInput()
prefix_2 = Text(prefix)
lng = ListLength(List=flatten(prefix_2))
series = Series(Start=0, Step=1, Count=lng)  # -> graft(Series)
cset = CreateSet(List=flatten(prefix_2))  # -> Set, Map
assign_paths = AssignPaths(InputData=flatten(series), PathsToAssign=flatten(cset.Map))  # -> flatten(RestructuredData)
assign_paths_2 = AssignPaths(InputData=flatten(prefix_2), PathsToAssign=flatten(cset.Map))
lng_2 = ListLength(List=assign_paths_2)
series_2 = Series(Start=0, Step=1, Count=lng_2)  # -> flatten(Series)
bbox = BoundingBox(Content=C, Plane=PlaneXY(0, 0, 0), UnionBox=True)  # -> Box, Box_2
sort = SortList(Keys=assign_paths, ValuesA=series_2)  # -> Keys, ValuesA
unflatten = UnflattenTree(Tree=sort.ValuesA, Guide=bbox.Box)
python = GhPythonScript(total_running=series, prefix=prefix_2, type_running=unflatten)  # -> out, module_name; inputs total_running: Int32, type_running: Int32
# ---------- python: Python ----------
__author__ = "mm1013"
__version__ = "2021.11.13"


module_name = ("%s" % int(total_running)).ljust(3) + prefix + ("%s" % int(type_running)).rjust(2)

module_name = '{0:03} {1} {2:02}'.format(total_running, prefix, type_running)
# ---------- end python ----------
module_name = ClusterOutput(python.module_name)

# ==== cluster Cluster_6
content = ClusterInput()
bounding_box = BoundingBox(Content=content, Plane=PlaneXY(0, 0, 0))  # -> Box, Box_2
box_properties = BoxProperties(Box=bounding_box.Box)  # -> Center, Diagonal, Area, Volume, Degeneracy
center = ClusterOutput(box_properties.Center)

# ==== cluster Cluster_7
V = ClusterInput()
vlen = VectorLength(Vector=V)
item = ListItem(List=vlen, Index=0, Wrap=True)
i = ClusterOutput(item)

# ==== cluster Cluster_8
C = ClusterInput()
bbox = BoundingBox(Content=C, Plane=PlaneXY(0, 0, 0), UnionBox=True)  # -> Box, Box_2
box_properties = BoxProperties(Box=bbox.Box)  # -> Center, Diagonal, Area, Volume, Degeneracy
scale = Scale(Geometry=bbox.Box, Center=box_properties.Center, Factor="1.1")  # -> Geometry, Transform
color = ClusterInput()
edges = BrepEdges(Brep=scale.Geometry)  # -> Naked, Interior, NonManifold
dc = DrawCurves(Curves=flatten(edges.Interior), Color=color)  # inputs Curves: list of Polyline, Color: Color
#   port Curves: Curves to render {list,curve}
# ---------- dc: Python ----------
ghenv.Component.Name = "DrawCurves"
ghenv.Component.NickName = "DC"

from ghpythonlib.componentbase import executingcomponent as component
import Rhino as rc
import System
import re
import math



class MyComponent(component):
    
    def RunScript(self,Curves, Color):
        self.curves = Curves

        self.color = Color
        
        self.pls = []
        for crv in self.curves:
            
            self.pls.append(crv)
            #self.pls.append(crv.ToPolyline(rc.RhinoDoc.ActiveDoc.ModelAbsoluteTolerance,
            #rc.RhinoDoc.ActiveDoc.ModelAngleToleranceRadians,
            #self.threshold/10,
            #self.threshold).ToPolyline())
 

    def DrawViewportWires(self,arg):
        

        for pl in self.pls:

            
            arg.Display.DrawDottedPolyline(pl, self.color, True)
            #arg.Display.DrawDottedLine(pl, self.color)
        #edges = srf.Edges
        
        #for edge in edges:
        #
# ---------- end dc ----------

# ==== cluster ABC
data = ClusterInput()
data_2 = Data(data)
path_mapper = PathMapper(
    data_2,
    source=["{A;B;C;D;E;F;G}", "{A;B;C;D;E;F}", "{A;B;C;D;E}", "{A;B;C;D}", "{A;B;C}", "{A;B}", "{A}"],
    target=["{A}", "{A}", "{A}", "{A}", "{A}", "{A}", "{A}"])
data_3 = Data(path_mapper)
data_4 = ClusterOutput(data_3)
