# Grasshopper definition goldfinger2.gh (Grasshopper 1.0.7)
# Copyright: 2021-25-30
# Copyright: 2021
# plug-ins: Monoceros, Linkajou, InteractiveTownBuilder

number_slider = Slider(55, range=0..500)
cluster = Cluster_2(B=number_slider, B_2=number_slider, B_3=Slider(33, range=0..500))

# ----
# Goldfinger
number_slider_2 = Slider(4.2, range=2..6)
# Project Goldfinger
number_slider_3 = Slider(3.6, range=2..6)
itb = InteractiveTownBuilder(
    BoundingBox=cluster,
    XSize=number_slider_3,
    YSize=number_slider_3,
    ZSize=number_slider_2,
    Enable=Toggle(False),
    Reset=Button(),
    AllowCantilever=Toggle(True))  # -> Slots, Boxes, Model
# AEC Hackathon 2021
cluster_2 = Cluster(B=cluster, F=number_slider_2)

cluster_3 = Cluster_3(B=cluster)
cluster_4 = Cluster_4(F=number_slider_2, box=cluster)

# ---- group: dashboard
# Dashboard
python = GhPythonScript(model=itb.Model)  # -> out, footprint, boxesMesh
# ---------- python: Python ----------
__author__ = "mm1013"
__version__ = "2021.10.31"

import rhinoscriptsyntax as rs
import ghpythonlib as ghp

boxesMesh = [model.GetFaces(vox) for vox in model.Voxels if vox.Z == 1]
footprint = len(boxesMesh)

boxesMesh = ghp.treehelpers.list_to_tree(boxesMesh)
# ---------- end python ----------
python_2 = GhPythonScript(x=itb.Model)  # -> out, max_cells, current_cell_count, ground_cell_count
# ---------- python_2: Python ----------
__author__ = "mm1013"
__version__ = "2021.10.30"

import rhinoscriptsyntax as rs

max_cells = x.GridDimensions[0] * x.GridDimensions[1] * (x.GridDimensions[2] - 1)

ground_cell_count = x.GridDimensions[0] * x.GridDimensions[1]

current_cell_count = len(x.Voxels) - ground_cell_count
# ---------- end python_2 ----------
division = Division(A=python_2.current_cell_count, B=python_2.ground_cell_count)
mjoin = MeshJoin(Meshes=flatten(python.boxesMesh))
multiplication = Multiplication(A=division, B=100)
multiplication_2 = Multiplication(A=python_2.max_cells, B="0.02")
dash_i = DashboardItem(
    Name="Density",
    _Description="Building density",
    Value=multiplication,
    _MinValue=0,
    _MaxValue="30",
    _Color=ColourSwatch(SwatchColor=RGB(38, 97, 66)),
    _ShowSub=True,
    _decimals=1)
dash_i_2 = DashboardItem(
    Name="Footprint",
    _Description="How many cells in first floor",
    Value=python.footprint,
    _MinValue=0,
    _MaxValue=python_2.ground_cell_count,
    _Color=ColourSwatch(SwatchColor=RGB(178, 137, 86)),
    _ShowSub=True,
    _decimals=1,
    _AssociatedGeo=mjoin)
dash_i_3 = DashboardItem(
    Name="Boxes added",
    _Description="Boxes",
    Value=python_2.current_cell_count,
    _MinValue=0,
    _MaxValue=multiplication_2,
    _Color=ColourSwatch(SwatchColor=RGB(38, 97, 66)),
    _ShowSub=True,
    _decimals=1)
expression = Expression(x=multiplication, Expression="Format(\"Goldfinger Points: {0:0}\", x*10)")
panel = Panel("GoldFinger")
dash_i_4 = DashboardItem(
    Name=expression,
    _Description="Aggregate points",
    Value=multiplication,
    _MinValue=0,
    _MaxValue="30",
    _Color=ColourSwatch(SwatchColor=RGB(43, 43, 43)),
    _SubItems=[dash_i_3, dash_i, dash_i_2],
    _ShowSub=True,
    _decimals=1)
dash_p = DashboardProperties(
    _X=-1,
    _Y=-1,
    _Width=-1,
    _Scale=Slider(1.6, range=0..2.5),
    _FontSize=-1,
    _Padding=-1,
    _LineHeight=-1,
    _HorizontalOffset=-1,
    _Frame=-1,
    _TextVerticalOffset=0,
    _AllViewports=False,
    _ShowTargets=True)
d_show = DashboardShow(Items=flatten(dash_i_4), _Properties=dash_p, _Enable=True)

# ----
xy = XYPlane(Origin=Point(0, 0, 0))

# ---- group: monoceros
# Monoceros solver
geometry_pipeline = GeometryPipeline(
    GroupByLayer=False,
    GroupByType=False,
    IncludeHidden=True,
    IncludeLocked=True,
    LayerFilter="layer-1::cages",
    NameFilter="*",
    SublayerFiltering=True,
    TypeFilter=1073741852)
geometry_pipeline_2 = GeometryPipeline(
    GroupByLayer=False,
    GroupByType=False,
    IncludeHidden=True,
    IncludeLocked=True,
    LayerFilter="layer-1::geometry",
    NameFilter="*",
    SublayerFiltering=True,
    TypeFilter=1073741885)
python_3 = GhPythonScript(model=itb.Model)  # -> out, boxesMesh
# ---------- python_3: Python ----------
__author__ = "mm1013"
__version__ = "2021.10.31"

import rhinoscriptsyntax as rs
import ghpythonlib as ghp

boxesMesh = [model.GetFaces(vox) for vox in model.Voxels if vox.Z !=0]


boxesMesh = ghp.treehelpers.list_to_tree(boxesMesh)
# ---------- end python_3 ----------
geometry_pipeline_3 = GeometryPipeline(
    GroupByLayer=False,
    GroupByType=False,
    IncludeHidden=True,
    IncludeLocked=True,
    LayerFilter="layer-2::cages",
    NameFilter="*",
    SublayerFiltering=True,
    TypeFilter=1073741852)
geometry_pipeline_4 = GeometryPipeline(
    GroupByLayer=False,
    GroupByType=False,
    IncludeHidden=True,
    IncludeLocked=True,
    LayerFilter="layer-2::geometry",
    NameFilter="*",
    SublayerFiltering=True,
    TypeFilter=1073741885)
bounding_box = BoundingBox(Content=geometry_pipeline_2, Plane=PlaneXY(0, 0, 0))  # -> Box, Box_2
graft_tree = GraftTree(Tree=geometry_pipeline_2, IncludeEmptyLists=True, IncludeNullItems=True)
mjoin_2 = MeshJoin(Meshes=python_3.boxesMesh)
graft_tree_2 = GraftTree(Tree=geometry_pipeline, IncludeEmptyLists=True, IncludeNullItems=True)
area = Area(Geometry=mjoin_2)  # -> Area, Centroid
box_properties = BoxProperties(Box=bounding_box.Box)  # -> Center, Diagonal, Area, Volume, Degeneracy
tree_statistics = TreeStatistics(Tree=graft_tree)  # -> Paths, Length, Count
pt = Point(flatten(area.Centroid))
bounding_box_2 = BoundingBox(Content=geometry_pipeline_4, Plane=PlaneXY(0, 0, 0))  # -> Box, Box_2
graft_tree_3 = GraftTree(Tree=geometry_pipeline_4, IncludeEmptyLists=True, IncludeNullItems=True)
graft_tree_4 = GraftTree(Tree=geometry_pipeline_3, IncludeEmptyLists=True, IncludeNullItems=True)
box_properties_2 = BoxProperties(Box=graft_tree_2)  # -> Center, Diagonal, Area, Volume, Degeneracy
point_in_breps = PointInBreps(Brep=geometry_pipeline, Point=box_properties.Center, Strict=False, UseTasks=False)  # -> Inside, Index
box_properties_3 = BoxProperties(Box=bounding_box_2.Box)  # -> Center, Diagonal, Area, Volume, Degeneracy
tree_statistics_2 = TreeStatistics(Tree=graft_tree_3)  # -> Paths, Length, Count
replace_paths = ReplacePaths(Data=graft_tree, Search=tree_statistics.Paths, Replace=point_in_breps.Index)
box_properties_4 = BoxProperties(Box=graft_tree_4)  # -> Center, Diagonal, Area, Volume, Degeneracy
tree_statistics_3 = TreeStatistics(Tree=replace_paths)  # -> Paths, Length, Count
point_in_breps_2 = PointInBreps(Brep=geometry_pipeline_3, Point=box_properties_3.Center, Strict=False, UseTasks=False)  # -> Inside, Index
series = Series(Start=0, Step=1, Count=tree_statistics_3.Count)
replace_paths_2 = ReplacePaths(Data=graft_tree_3, Search=tree_statistics_2.Paths, Replace=point_in_breps_2.Index)
tree_statistics_4 = TreeStatistics(Tree=replace_paths_2)  # -> Paths, Length, Count
xy_2 = XYPlane(Origin=Point(1.8, 1.8, -2.1))
concatenate = Concatenate(FragmentA="layer-1-", FragmentB=series)  # -> graft(Result)
pln = Plane(xy)
series_2 = Series(Start=0, Step=1, Count=tree_statistics_4.Count)
pt_2 = ConstructPoint(XCoordinate=number_slider_3, YCoordinate=number_slider_3, ZCoordinate=number_slider_2)
pt_3 = Point(pt)
move = Move(Geometry=pln, Motion=expr("x*0.5", pt_2))  # -> Geometry, Transform
concatenate_2 = Concatenate(FragmentA="layer-2-", FragmentB=series_2)  # -> graft(Result)
construct_module = ConstructModule(
    ModuleName=concatenate,
    ModulePartPoints=box_properties_2.Center,
    Geometry=replace_paths,
    BasePlane=PlaneXY(0, 0, 0),
    ModulePartDiagonal=pt_2)  # -> flatten(Module)
construct_slot_with_all_modules_allowed = ConstructSlotWithAllModulesAllowed(SlotPoint=pt_3, BasePlane=move.Geometry, GridSlotDiagonal=pt_2)
construct_module_2 = ConstructModule(
    ModuleName=concatenate_2,
    ModulePartPoints=box_properties_4.Center,
    Geometry=replace_paths_2,
    BasePlane=PlaneXY(0, 0, 0),
    ModulePartDiagonal=pt_2)  # -> flatten(Module)
suggest_rules_from_geometry = SuggestRulesFromGeometry(Modules=construct_module_2)  # -> Rules, RulesIndifferent
suggest_rules_from_geometry_2 = SuggestRulesFromGeometry(Modules=construct_module)  # -> Rules, RulesIndifferent
preview_rules = PreviewRules(Modules=construct_module_2, Rules=suggest_rules_from_geometry.Rules)
merge = Merge(Data1=suggest_rules_from_geometry_2.Rules, Data2=suggest_rules_from_geometry.Rules)  # -> flatten(Result)
preview_rules_2 = PreviewRules(Modules=construct_module, Rules=suggest_rules_from_geometry_2.Rules)
module = Module(flatten([construct_module, construct_module_2]))
suggest_rules_from_geometry_3 = SuggestRulesFromGeometry(Modules=module)  # -> Rules, RulesIndifferent
module_2 = Module(flatten([construct_module, construct_module_2]))
geometry = Geometry([<curve referenced from the Rhino model> x13])
slots_from_geometry = SlotsFromGeometry(Geometry=geometry, Module=module_2, BasePlane=PlaneXY(0, 0, 0))  # -> flatten(Slots)
scan_slots_for_rules = ScanSlotsForRules(Slots=slots_from_geometry, Modules=module_2)
slot = Slot(flatten(construct_slot_with_all_modules_allowed))
rule = Rule(flatten([suggest_rules_from_geometry_2.Rules, suggest_rules_from_geometry_2.RulesIndifferent, suggest_rules_from_geometry.Rules, suggest_rules_from_geometry.RulesIndifferent]))
rule_2 = Rule(flatten([suggest_rules_from_geometry_3.Rules, suggest_rules_from_geometry_3.RulesIndifferent]))
monoceros_wfc_solver = MonocerosWFCSolver(
    Slots=slot,
    Modules=module,
    Rules=rule,
    RandomSeed=Slider(59, range=0..100),
    MaxAttempts=Slider(301, range=0..1000),
    MaxObservations=2147483647,
    MaxTime=0,
    UseShannonEntropy=False)  # -> Out, Slots, Deterministic, Contradictory, Seed, Attempts, Observations
materialize_slots = MaterializeSlots(Modules=module, Slots=monoceros_wfc_solver.Slots)  # -> Geometry, Transform
panel_2 = Panel(monoceros_wfc_solver.Out)

# ----
# preview slots
S = Slot(construct_slot_with_all_modules_allowed)

# ---- group: monoceros / Catalog of rules
list_length = ListLength(List=merge)
series_3 = Series(Start=0, Step="3", Count=list_length)
construct_point = ConstructPoint(XCoordinate=0, YCoordinate=series_3, ZCoordinate=0)
xy_plane = XYPlane(Origin=construct_point)
assemble_rule = AssembleRule(Modules=module, Rule=merge, BasePlane=xy_plane)  # -> SourceGeometry, TargetGeometry

# ==== cluster Cluster
B = ClusterInput()
debrep = DeconstructBrep(Brep=B)  # -> Faces, Edges, Vertices
F = ClusterInput()
item = ListItem(List=debrep.Faces, Index=Slider(4, range=0..5), Wrap=True)
Z = UnitZ(Factor=F)
multiplication = Multiplication(A=Z, B=0.99)
move = Move(Geometry=item, Motion=multiplication)  # -> Geometry, Transform
area = Area(Geometry=move.Geometry)  # -> Area, Centroid
scale_nu = ScaleNU(Geometry=move.Geometry, Plane=area.Centroid, ScaleX="1.4", ScaleY="1.4", ScaleZ=1)  # -> Geometry, Transform
Z_2 = UnitZ(Factor="-1")
extr = Extrude(Base=scale_nu.Geometry, Direction=Z_2)
preview = CustomPreview(Geometry=extr, Material=ColourSwatch(SwatchColor=RGB(128, 128, 128)))

# ==== cluster Cluster_2
B = ClusterInput()
B_2 = ClusterInput()
B_3 = ClusterInput()
dom = ConstructDomain(DomainStart=0, DomainEnd=B)
dom_2 = ConstructDomain(DomainStart=0, DomainEnd=B_2)
dom_3 = ConstructDomain(DomainStart=0, DomainEnd=B_3)
box = DomainBox(Base=PlaneXY(0, 0, 0), X=dom, Y=dom_2, Z=dom_3)
B_4 = ClusterOutput(box)

# ==== cluster Cluster_3
panel = Panel("""6
10""")
B = ClusterInput()
edges = BrepEdges(Brep=B)  # -> Naked, Interior, NonManifold
dash = DashPattern(Curve=edges.Interior, Pattern=panel)  # -> Dashes, Gaps
previewlw = CustomPreviewLineweights(Geometry=dash.Dashes, Shader=ColourSwatch(SwatchColor=RGB(56, 56, 56)), Absolute=False)

# ==== cluster Cluster_4
box = ClusterInput()
F = ClusterInput()
box_2 = Box(box)
Z = UnitZ(Factor=F)
box_3 = EvaluateBox(Box=box_2, UParameter=0.5, VParameter=0.5, WParameter=0.05)  # -> Plane, Point, Include
box_4 = EvaluateBox(Box=box_2, UParameter=0.5, VParameter=-0.1, WParameter=0.01)  # -> Plane, Point, Include
move = Move(Geometry=box_4.Plane, Motion=Z)  # -> Geometry, Transform
panel = Panel("""0
90
180
270""")
panel_2 = Panel("""Project GoldFinger
AEC Hackathon 2021
Copenhagen
Bloxhub""")
rotate = Rotate(Geometry=move.Geometry, Angle=degrees(panel), Plane=box_3.Plane)  # -> Geometry, Transform
tag = TextTag3D(Location=rotate.Geometry, Text=panel_2, Size="5", Colour=ColourSwatch(SwatchColor=RGB(138, 138, 138)), Justification=5)
